# Dynamo graph AutoDimensions_2021_UI.dyn (Dynamo 2.6.1.8786)
# packages: Genius Loci 2020.8.20, Clockwork for Dynamo 2.x 2.3.0, Genius Loci 2021.1.12, Data-Shapes 2021.2.92

current = Document.Current()
activeView = Document.ActiveView(document=current)
code_block = CodeBlock { "First reference"; }
code_block_2 = CodeBlock { ["Cable Trays","Ducts","Pipes"]; }
categories = Categories("OST_CableTray")
categories_2 = Categories("OST_DuctCurves")
categories_3 = Categories("OST_PipeCurves")
code_block_3 = CodeBlock(x=categories, y=categories_2, z=categories_3) { [x,y,z]; }
ui_dropdown_data = Custom[UI.DropDown Data](InputName=code_block, Keys=code_block_2, Values=code_block_3)  # package Data-Shapes; Create data for DropDown input in UI.MultiInputForm ++ . Check out www.data-shapes.net for more infos.
code_block_4 = CodeBlock { "Second reference"; }
code_block_5 = CodeBlock { ["Grids","Walls"]; }
categories_4 = Categories("OST_Grids")
categories_5 = Categories("OST_Walls")
code_block_6 = CodeBlock(x=categories_4, y=categories_5) { [x,y]; }
ui_dropdown_data_2 = Custom[UI.DropDown Data](InputName=code_block_4, Keys=code_block_5, Values=code_block_6)
code_block_7 = CodeBlock { "Filter element by length"; }
code_block_8 = CodeBlock { "500"; }
ui_textbox_data = Custom[UI.TextBox Data](InputName=code_block_7, DefaultText=code_block_8)  # package Data-Shapes; Create Data for TextBox input in UI.MultipleInputForm ++ . Check out www.data-shapes.net for more informations
code_block_9 = CodeBlock { "Remove identical dimensions?"; }
code_block_10 = CodeBlock { "Yes"; }
ui_boolean_input = Custom[UI.Boolean input](InputName=code_block_9, SideText=code_block_10)  # package Data-Shapes; Creates a boolean input for UI.MultipleInputForm ++ . Check out www.data-shapes.net for more infos!
list_create = List.Create(item0=ui_dropdown_data, item1=ui_dropdown_data_2, item2=ui_textbox_data, item3=ui_boolean_input)
boolean = BoolSelector(true)
multipleinputform = Custom[MultipleInputForm ++](Inputs=list_create, Toggle=boolean)  # package Data-Shapes; Create a form with multiple inputs. see www.data-shapes.net for tutorials and infos!
code_block_11 = CodeBlock { 3; }
getItemAtIndex = List.GetItemAtIndex(list=multipleinputform.User_Inputs, index=code_block_11)
code_block_12 = CodeBlock { 1; }
getItemAtIndex_2 = List.GetItemAtIndex(list=multipleinputform.User_Inputs, index=code_block_12)
string_from_object = FromObject(obj=getItemAtIndex_2)
code_block_13 = CodeBlock { "Grids"; }
eq = string_from_object == code_block_13
code_block_14 = CodeBlock { 0; }
getItemAtIndex_3 = List.GetItemAtIndex(list=multipleinputform.User_Inputs, index=code_block_14)
code_block_15 = CodeBlock { "Width"; }
code_block_16 = CodeBlock { ""; }
code_block_17 = CodeBlock { 2; }
getItemAtIndex_4 = List.GetItemAtIndex(list=multipleinputform.User_Inputs, index=code_block_17)
toNumber = String.ToNumber(str=getItemAtIndex_4)

# group: Filter by View and Length
current_2 = Document.Current()
activeView_2 = Document.ActiveView(document=current_2)
all_elements_of_category_in_view = ElementsOfCategoryInView(Category=getItemAtIndex_3, View=activeView_2)
code_block_18 = CodeBlock { "Length"; }

getParameterValueByName = Element.GetParameterValueByName(element=all_elements_of_category_in_view, parameterName=code_block_15)
eq_2 = getParameterValueByName == code_block_16
filterByBoolMask = List.FilterByBoolMask(list=all_elements_of_category_in_view, mask=eq_2)
python_script = Python(IN[0]=eq, IN[1]=all_elements_of_category_in_view, IN[2]=filterByBoolMask.out)
# ---------- python_script.python (16 lines) ----------
# Load the Python Standard and DesignScript Libraries
import sys
import clr
clr.AddReference('ProtoGeometry')
from Autodesk.DesignScript.Geometry import *

# The inputs to this node will be stored as a list in the IN variables.
dataEnteringNode = IN
res=[]
# Place your code below this line
if IN[0]==True:
	res=(IN[1])
else:
	res=(IN[2])
# Assign your output to the OUT variable.
OUT = res
# ----------------------------------------

# group (continued): Filter by View and Length
getParameterValueByName_2 = Element.GetParameterValueByName(element=python_script, parameterName=code_block_18)
gt = getParameterValueByName_2 > toNumber
filterByBoolMask_2 = List.FilterByBoolMask(list=python_script, mask=gt)

# group: Filter by XY direction
getLocation = Element.GetLocation(element=filterByBoolMask_2.in)
direction = Line.Direction(line=getLocation)
XAxis = Vector.XAxis()
YAxis = Vector.YAxis()
ZAxis = Vector.ZAxis()
list_create_2 = List.Create(item0=XAxis, item1=YAxis, item2=ZAxis)
isParallel = Vector.IsParallel(vector=direction, other=list_create_2, lacing=CrossProduct)
code_block_19 = CodeBlock { false; }
allIndicesOf = List.AllIndicesOf(list=isParallel@L2, item=code_block_19)
count = List.Count(list=allIndicesOf@L2)
code_block_20 = CodeBlock { 3; }
eq_3 = count == code_block_20
code_block_21 = CodeBlock { true; }
allIndicesOf_2 = List.AllIndicesOf(list=isParallel@L2, item=code_block_21)
code_block_22 = CodeBlock { [0,1]; }

isEmpty = List.IsEmpty(list=allIndicesOf_2@L2)
count_2 = List.Count(list=isEmpty)
code_block_23 = CodeBlock(x=count_2) { x-1; }
python_script_2 = Python(IN[0]=isEmpty, IN[1]=allIndicesOf_2, IN[2]=code_block_23)
# ---------- python_script_2.python (20 lines) ----------
# Load the Python Standard and DesignScript Libraries
import sys
import clr
clr.AddReference('ProtoGeometry')
from Autodesk.DesignScript.Geometry import *

# The inputs to this node will be stored as a list in the IN variables.
dataEnteringNode = IN
res=[]
j=IN[2]
i=0
# Place your code below this line
while i<j:
	if IN[0][i]==False:
		res.append(IN[1][i][0])
	else:
		res.append(2)
	i=i+1
# Assign your output to the OUT variable.
OUT = res
# ----------------------------------------

# group (continued): Filter by XY direction
formula = Formula("if(x=true,2,y)", x=eq_3, y=python_script_2, lacing=Longest)
groupByKey = List.GroupByKey(list=filterByBoolMask_2.in, keys=formula)

sortByKey = List.SortByKey(list=groupByKey.groups, keys=groupByKey.unique_keys)

# group (continued): Filter by XY direction
getItemAtIndex_5 = List.GetItemAtIndex(list=sortByKey.sorted_list, index=code_block_22)

code_block_24 = CodeBlock { 1; }
Y = List.GetItemAtIndex(list=getItemAtIndex_5, index=code_block_24)
code_block_25 = CodeBlock(x=Y) { x; }

# group: Separate grids by direction
categories_6 = Categories("OST_Grids")
XAxis_2 = Vector.XAxis()
YAxis_2 = Vector.YAxis()
ZAxis_2 = Vector.ZAxis()
list_create_3 = List.Create(item0=XAxis_2, item1=YAxis_2, item2=ZAxis_2)
code_block_26 = CodeBlock { false; }
code_block_27 = CodeBlock { 3; }
code_block_28 = CodeBlock { true; }
code_block_29 = CodeBlock { [0,1]; }
code_block_30 = CodeBlock { 1; }
code_block_31 = CodeBlock { 1; }
code_block_32 = CodeBlock { 0; }
code_block_33 = CodeBlock { 0; }

formula_2 = Formula("if(x=true,y,false)", x=eq, y=categories_6)

# group (continued): Separate grids by direction
all_elements_of_category = ElementsOfCategory(Category=formula_2)
curve = Grid.Curve(grid=all_elements_of_category)
direction_2 = Line.Direction(line=curve)
isParallel_2 = Vector.IsParallel(vector=direction_2, other=list_create_3, lacing=CrossProduct)
allIndicesOf_3 = List.AllIndicesOf(list=isParallel_2@L2, item=code_block_26)
count_3 = List.Count(list=allIndicesOf_3@L2)
eq_4 = count_3 == code_block_27
allIndicesOf_4 = List.AllIndicesOf(list=isParallel_2@L2, item=code_block_28)
flatten = List.Flatten(list=allIndicesOf_4)
formula_3 = Formula("if(x=true,2,y)", x=eq_4, y=flatten, lacing=Longest)
groupByKey_2 = List.GroupByKey(list=all_elements_of_category, keys=formula_3)
getItemAtIndex_6 = List.GetItemAtIndex(list=groupByKey_2.groups, index=code_block_29)
Y_2 = List.GetItemAtIndex(list=getItemAtIndex_6, index=code_block_30)
curve_2 = Grid.Curve(grid=getItemAtIndex_6)
Y_3 = List.GetItemAtIndex(list=curve_2, index=code_block_31)
X = List.GetItemAtIndex(list=getItemAtIndex_6, index=code_block_32)
X_2 = List.GetItemAtIndex(list=curve_2, index=code_block_33)

code_block_34 = CodeBlock(x=Y_2) { x; }
getLocation_2 = Element.GetLocation(element=getItemAtIndex_5)
ZAxis_3 = Vector.ZAxis()
reverse = Vector.Reverse(vector=ZAxis_3)
startPoint = Curve.StartPoint(curve=getLocation_2)
Z = Point.Z(point=startPoint)
translate = Geometry.Translate(geometry=getLocation_2, direction=reverse, distance=Z)
code_block_35 = CodeBlock { 1; }
Y_4 = List.GetItemAtIndex(list=translate, index=code_block_35)
distanceTo = Geometry.DistanceTo(geometry=Y_4, other=Y_3, lacing=CrossProduct)
formula_4 = Formula("if(x=0,100000000,x)", x=distanceTo)
minimumItem = List.MinimumItem(list=formula_4)
allIndicesOf_5 = List.AllIndicesOf(list=formula_4@L2, item=minimumItem)
flatten_2 = List.Flatten(list=allIndicesOf_5@@L3)
code_block_36 = CodeBlock { 0; }
getItemAtIndex_7 = List.GetItemAtIndex(list=flatten_2@L2, index=code_block_36)

# group: Y set
code_block_37 = CodeBlock(x=code_block_25) { x; }
getItemAtIndex_8 = List.GetItemAtIndex(list=code_block_34, index=getItemAtIndex_7)

flatten_3 = List.Flatten(list=getItemAtIndex_8)
list_create_4 = List.Create(item0=code_block_37, item1=flatten_3)
count_4 = List.Count(list=flatten_3)
code_block_38 = CodeBlock(x=count_4) { 0..x-1; }
getItemAtIndex_9 = List.GetItemAtIndex(list=code_block_38@L1, index=code_block_38, lacing=CrossProduct)
flatten_4 = List.Flatten(list=getItemAtIndex_9@L1)
flatten_5 = List.Flatten(list=flatten_4@L1)
getItemAtIndex_10 = List.GetItemAtIndex(list=list_create_4@L4, index=flatten_5, lacing=CrossProduct)
flatten_6 = List.Flatten(list=getItemAtIndex_10@L2)
code_block_39 = CodeBlock { 0.5; }
pointAtParameter = Curve.PointAtParameter(curve=Y_4, param=code_block_39)
ZAxis_4 = Vector.ZAxis()
code_block_40 = CodeBlock { 90; }
rotate = Geometry.Rotate(geometry=Y_4, origin=pointAtParameter, axis=ZAxis_4, degrees=code_block_40)
code_block_41 = CodeBlock { 0; }
X_3 = List.GetItemAtIndex(list=getItemAtIndex_5, index=code_block_41)
code_block_42 = CodeBlock(x=X_3) { x; }
code_block_43 = CodeBlock(x=X) { x; }
code_block_44 = CodeBlock { 0; }
X_4 = List.GetItemAtIndex(list=translate, index=code_block_44)
distanceTo_2 = Geometry.DistanceTo(geometry=X_4, other=X_2, lacing=CrossProduct)
formula_5 = Formula("if(x=0,100000000,x)", x=distanceTo_2)
minimumItem_2 = List.MinimumItem(list=formula_5)

# group: Remove duplicate values?
code_block_45 = CodeBlock { 4; }
round = Math.Round(number=minimumItem, digits=code_block_45)
eq_5 = round == round  # lacing=CrossProduct
code_block_46 = CodeBlock { true; }
allIndicesOf_6 = List.AllIndicesOf(list=eq_5@L2, item=code_block_46)
code_block_47 = CodeBlock { 0; }
getItemAtIndex_11 = List.GetItemAtIndex(list=allIndicesOf_6@L2, index=code_block_47)
setDifference = List.SetDifference(list1=allIndicesOf_6, list2=getItemAtIndex_11)
flatten_7 = List.Flatten(list=setDifference)
uniqueItems = List.UniqueItems(list=flatten_7)
code_block_48 = CodeBlock { 4; }
round_2 = Math.Round(number=minimumItem_2, digits=code_block_48)
eq_6 = round_2 == round_2  # lacing=CrossProduct
code_block_49 = CodeBlock { true; }
allIndicesOf_7 = List.AllIndicesOf(list=eq_6@L2, item=code_block_49)
code_block_50 = CodeBlock { 0; }
getItemAtIndex_12 = List.GetItemAtIndex(list=allIndicesOf_7@L2, index=code_block_50)
setDifference_2 = List.SetDifference(list1=allIndicesOf_7, list2=getItemAtIndex_12)
flatten_8 = List.Flatten(list=setDifference_2)
uniqueItems_2 = List.UniqueItems(list=flatten_8)

removeItemAtIndex = List.RemoveItemAtIndex(list=flatten_6, indices=uniqueItems)
python_script_3 = Python(IN[0]=getItemAtIndex, IN[1]=flatten_6, IN[2]=removeItemAtIndex)
# ---------- python_script_3.python (16 lines) ----------
# Load the Python Standard and DesignScript Libraries
import sys
import clr
clr.AddReference('ProtoGeometry')
from Autodesk.DesignScript.Geometry import *

# The inputs to this node will be stored as a list in the IN variables.
dataEnteringNode = IN
res=[]
# Place your code below this line
if IN[0]==False:
	res=(IN[1])
else:
	res=(IN[2])
# Assign your output to the OUT variable.
OUT = res
# ----------------------------------------
removeItemAtIndex_2 = List.RemoveItemAtIndex(list=rotate, indices=uniqueItems)
python_script_4 = Python(IN[0]=getItemAtIndex, IN[1]=rotate, IN[2]=removeItemAtIndex_2)  # same code as python_script_3
byElements = Dimension.ByElements(view=activeView, referenceElements=python_script_3, line=python_script_4)
allIndicesOf_8 = List.AllIndicesOf(list=formula_5@L2, item=minimumItem_2)
flatten_9 = List.Flatten(list=allIndicesOf_8@@L3)
getItemAtIndex_13 = List.GetItemAtIndex(list=flatten_9@L2, index=code_block_36)

# group: X set
code_block_51 = CodeBlock(x=code_block_42) { x; }
getItemAtIndex_14 = List.GetItemAtIndex(list=code_block_43, index=getItemAtIndex_13)

flatten_10 = List.Flatten(list=getItemAtIndex_14)
list_create_5 = List.Create(item0=code_block_51, item1=flatten_10)
count_5 = List.Count(list=flatten_10)
code_block_52 = CodeBlock(x=count_5) { 0..x-1; }
getItemAtIndex_15 = List.GetItemAtIndex(list=code_block_52@L1, index=code_block_52, lacing=CrossProduct)
flatten_11 = List.Flatten(list=getItemAtIndex_15@L1)
flatten_12 = List.Flatten(list=flatten_11@L1)
getItemAtIndex_16 = List.GetItemAtIndex(list=list_create_5@L4, index=flatten_12, lacing=CrossProduct)
flatten_13 = List.Flatten(list=getItemAtIndex_16@L2)
removeItemAtIndex_3 = List.RemoveItemAtIndex(list=flatten_13, indices=uniqueItems_2)
python_script_5 = Python(IN[0]=getItemAtIndex, IN[1]=flatten_13, IN[2]=removeItemAtIndex_3)  # same code as python_script_3
code_block_53 = CodeBlock { 0.5; }
pointAtParameter_2 = Curve.PointAtParameter(curve=X_4, param=code_block_53)
rotate_2 = Geometry.Rotate(geometry=X_4, origin=pointAtParameter_2, axis=ZAxis_4, degrees=code_block_40)
removeItemAtIndex_4 = List.RemoveItemAtIndex(list=rotate_2, indices=uniqueItems_2)
python_script_6 = Python(IN[0]=getItemAtIndex, IN[1]=rotate_2, IN[2]=removeItemAtIndex_4)  # same code as python_script_3
byElements_2 = Dimension.ByElements(view=activeView, referenceElements=python_script_5, line=python_script_6)

# group: Find side surface of the element
flatten_14 = List.Flatten(list=getItemAtIndex_5)
faces = Element.Faces(element=flatten_14)
edges = Topology.Edges(topology=faces)
curveGeometry = Edge.CurveGeometry(edge=edges)
startPoint_2 = Curve.StartPoint(curve=curveGeometry)
endPoint = Curve.EndPoint(curve=curveGeometry)
byStartPointEndPoint = Line.ByStartPointEndPoint(startPoint=startPoint_2, endPoint=endPoint)
direction_3 = Line.Direction(line=byStartPointEndPoint)
ZAxis_5 = Vector.ZAxis()
isParallel_3 = Vector.IsParallel(vector=direction_3, other=ZAxis_5)
uniqueItems_3 = List.UniqueItems(list=isParallel_3@@L2)
countTrue = List.CountTrue(list=uniqueItems_3@@L2)
formula_6 = Formula("if(x=0,true,false)", x=countTrue)
filterByBoolMask_3 = List.FilterByBoolMask(list=faces, mask=formula_6)
filterByBoolMask_4 = List.FilterByBoolMask(list=byStartPointEndPoint, mask=formula_6)
direction_4 = Line.Direction(line=filterByBoolMask_4.out)
X_5 = Vector.X(vector=direction_4)
maximumItem = List.MaximumItem(list=X_5)
maximumItem_2 = List.MaximumItem(list=maximumItem)
Y_5 = Vector.Y(vector=direction_4)
maximumItem_3 = List.MaximumItem(list=Y_5)
maximumItem_4 = List.MaximumItem(list=maximumItem_3)
formula_7 = Formula("if(x>y,x,y)", x=maximumItem_2, y=maximumItem_4)
eq_7 = maximumItem == formula_7
formula_8 = Formula("if(x=true,1,0)", x=eq_7)
eq_8 = maximumItem_3 == formula_7
formula_9 = Formula("if(x=true,1,0)", x=eq_8)
add = formula_8 + formula_9
formula_10 = Formula("if(x=0,false,true)", x=add)
filterByBoolMask_5 = List.FilterByBoolMask(list=filterByBoolMask_3.out, mask=formula_10)
code_block_54 = CodeBlock { "Middle Elevation"; }
getParameterValueByName_3 = Element.GetParameterValueByName(element=flatten_14, parameterName=code_block_54)

# group: Find Duct References
current_3 = Document.Current()
activeView_3 = Document.ActiveView(document=current_3)
code_block_55 = CodeBlock { 100; }
thicken = Surface.Thicken(surface=filterByBoolMask_5.in, thickness=code_block_55)
code_block_56 = CodeBlock { 0; }
code_block_57 = CodeBlock { -1; }
byCoordinates = Vector.ByCoordinates(x=code_block_56, y=code_block_56, z=code_block_57)
translate_2 = Geometry.Translate(geometry=thicken@L2, direction=byCoordinates, distance=getParameterValueByName_3)
categories_7 = Categories("OST_Walls")
current_4 = Document.Current()
activeView_4 = Document.ActiveView(document=current_4)
code_block_58 = CodeBlock { 2; }
code_block_59 = CodeBlock { 0; }
code_block_60 = CodeBlock { 1; }
ZAxis_6 = Vector.ZAxis()
reverse_2 = Vector.Reverse(vector=ZAxis_6)
code_block_61 = CodeBlock { 0.5; }
code_block_62 = CodeBlock { 0; }
code_block_63 = CodeBlock { 1; }
code_block_64 = CodeBlock { 0.5; }
ZAxis_7 = Vector.ZAxis()
code_block_65 = CodeBlock { 90; }
code_block_66 = CodeBlock { 0; }
code_block_67 = CodeBlock { true; }
code_block_68 = CodeBlock { 0; }
code_block_69 = CodeBlock { 1; }
code_block_70 = CodeBlock { 0; }
current_5 = Document.Current()
activeView_5 = Document.ActiveView(document=current_5)
code_block_71 = CodeBlock { 0; }
code_block_72 = CodeBlock { 1; }
code_block_73 = CodeBlock { 0.5; }
ZAxis_8 = Vector.ZAxis()
code_block_74 = CodeBlock { 90; }
code_block_75 = CodeBlock { 1; }
code_block_76 = CodeBlock { 0; }
code_block_77 = CodeBlock { 0; }

string_from_object_2 = FromObject(obj=getItemAtIndex_2)
code_block_78 = CodeBlock { "Walls"; }
eq_9 = string_from_object_2 == code_block_78
formula_11 = Formula("if(x=true,y,false)", x=eq_9, y=categories_7)

# group (continued): Find Duct References
all_elements_of_category_in_view_2 = ElementsOfCategoryInView(Category=formula_11, View=activeView_4)
wall_edges_references = Custom[Wall Edges References](wall=all_elements_of_category_in_view_2)  # package Genius Loci; Get the vertical and horizontal edges and their references from the exterior and interior faces. Also works with linked walls.
distanceTo_3 = Geometry.DistanceTo(geometry=translate_2, other=wall_edges_references.Interior_Side_Horizontal_Edges@L1, lacing=CrossProduct)
round_3 = Math.Round(number=distanceTo_3, digits=code_block_58)
formula_12 = Formula("if(x=0,100000000,x)", x=round_3)
minimumItem_3 = List.MinimumItem(list=formula_12)
minimumItem_4 = List.MinimumItem(list=minimumItem_3)
allIndicesOf_9 = List.AllIndicesOf(list=round_3@@L2, item=minimumItem_4)
flatten_15 = List.Flatten(list=allIndicesOf_9@@L4)
getItemAtIndex_17 = List.GetItemAtIndex(list=flatten_15@L2, index=code_block_59)
chop = List.Chop(list=getItemAtIndex_17, lengths=code_block_60)
getItemAtIndex_18 = List.GetItemAtIndex(list=filterByBoolMask_5.in@L2, index=chop@L2)
flatten_16 = List.Flatten(list=getItemAtIndex_18)
pointAtParameter_3 = Surface.PointAtParameter(surface=flatten_16, u=code_block_61, v=code_block_61)
Z_2 = Point.Z(point=pointAtParameter_3)
translate_3 = Geometry.Translate(geometry=flatten_16, direction=reverse_2, distance=Z_2)
normalAtPoint = Surface.NormalAtPoint(surface=flatten_16, point=pointAtParameter_3)
fromDynamoSurface = Custom[RevitFaceReference.FromDynamoSurface](DynamoSurface=flatten_16)  # package Clockwork for Dynamo 2.x; Returns the underlying Revit face reference of a given surface
flatten_17 = List.Flatten(list=wall_edges_references.Interior_Side_Horizontal_References)
flatten_18 = List.Flatten(list=wall_edges_references.Interior_Side_Horizontal_Edges)
startPoint_3 = Curve.StartPoint(curve=flatten_18)
X_6 = Point.X(point=startPoint_3)
Y_6 = Point.Y(point=startPoint_3)
byCoordinates_2 = Point.ByCoordinates(x=X_6, y=Y_6)
endPoint_2 = Curve.EndPoint(curve=flatten_18)
X_7 = Point.X(point=endPoint_2)
Y_7 = Point.Y(point=endPoint_2)
byCoordinates_3 = Point.ByCoordinates(x=X_7, y=Y_7)
byStartPointEndPoint_2 = Line.ByStartPointEndPoint(startPoint=byCoordinates_2, endPoint=byCoordinates_3)
string_from_object_3 = FromObject(obj=byStartPointEndPoint_2)
eq_10 = string_from_object_3 == string_from_object_3  # lacing=CrossProduct
allIndicesOf_10 = List.AllIndicesOf(list=eq_10@L2, item=code_block_67)
getItemAtIndex_19 = List.GetItemAtIndex(list=allIndicesOf_10@L2, index=code_block_68)
uniqueItems_4 = List.UniqueItems(list=getItemAtIndex_19)
getItemAtIndex_20 = List.GetItemAtIndex(list=flatten_17, index=uniqueItems_4)
getItemAtIndex_21 = List.GetItemAtIndex(list=byStartPointEndPoint_2, index=uniqueItems_4)
direction_5 = Line.Direction(line=getItemAtIndex_21)

isNull = Object.IsNull(obj=normalAtPoint)
filterByBoolMask_6 = List.FilterByBoolMask(list=translate_3, mask=isNull)
filterByBoolMask_7 = List.FilterByBoolMask(list=normalAtPoint, mask=isNull)

# group: Filter by XY direction
XAxis_3 = Vector.XAxis()
YAxis_3 = Vector.YAxis()
ZAxis_9 = Vector.ZAxis()
list_create_6 = List.Create(item0=XAxis_3, item1=YAxis_3, item2=ZAxis_9)
isParallel_4 = Vector.IsParallel(vector=filterByBoolMask_7.out, other=list_create_6, lacing=CrossProduct)
code_block_79 = CodeBlock { false; }
allIndicesOf_11 = List.AllIndicesOf(list=isParallel_4@L2, item=code_block_79)
count_6 = List.Count(list=allIndicesOf_11@L2)
code_block_80 = CodeBlock { 3; }
eq_11 = count_6 == code_block_80
code_block_81 = CodeBlock { true; }
allIndicesOf_12 = List.AllIndicesOf(list=isParallel_4@L2, item=code_block_81)
flatten_19 = List.Flatten(list=allIndicesOf_12)
formula_13 = Formula("if(x=true,2,y)", x=eq_11, y=flatten_19, lacing=Longest)
groupByKey_3 = List.GroupByKey(list=filterByBoolMask_6.out, keys=formula_13)
sortByKey_2 = List.SortByKey(list=groupByKey_3.groups, keys=groupByKey_3.unique_keys)
code_block_82 = CodeBlock { 0; }
X_8 = List.GetItemAtIndex(list=sortByKey_2.sorted_list, index=code_block_82)
code_block_83 = CodeBlock { 1; }
Y_8 = List.GetItemAtIndex(list=sortByKey_2.sorted_list, index=code_block_83)

# group (continued): Find Duct References
perimeterCurves = Surface.PerimeterCurves(surface=X_8)
length = Curve.Length(curve=perimeterCurves)
maximumItem_5 = List.MaximumItem(list=length)
allIndicesOf_13 = List.AllIndicesOf(list=length@L2, item=maximumItem_5)
flatten_20 = List.Flatten(list=allIndicesOf_13@@L3)
getItemAtIndex_22 = List.GetItemAtIndex(list=flatten_20@L2, index=code_block_62)
chop_2 = List.Chop(list=getItemAtIndex_22, lengths=code_block_63)
getItemAtIndex_23 = List.GetItemAtIndex(list=perimeterCurves@L2, index=chop_2@L2)
pointAtParameter_4 = Curve.PointAtParameter(curve=getItemAtIndex_23, param=code_block_64)
rotate_3 = Geometry.Rotate(geometry=getItemAtIndex_23, origin=pointAtParameter_4, axis=ZAxis_7, degrees=code_block_65)
startPoint_4 = Curve.StartPoint(curve=rotate_3)
endPoint_3 = Curve.EndPoint(curve=rotate_3)
byStartPointEndPoint_3 = Line.ByStartPointEndPoint(startPoint=startPoint_4, endPoint=endPoint_3)
perimeterCurves_2 = Surface.PerimeterCurves(surface=Y_8)
length_2 = Curve.Length(curve=perimeterCurves_2)
maximumItem_6 = List.MaximumItem(list=length_2)
allIndicesOf_14 = List.AllIndicesOf(list=length_2@L2, item=maximumItem_6)
flatten_21 = List.Flatten(list=allIndicesOf_14@@L3)
getItemAtIndex_24 = List.GetItemAtIndex(list=flatten_21@L2, index=code_block_71)
chop_3 = List.Chop(list=getItemAtIndex_24, lengths=code_block_72)
getItemAtIndex_25 = List.GetItemAtIndex(list=perimeterCurves_2@L2, index=chop_3@L2)
pointAtParameter_5 = Curve.PointAtParameter(curve=getItemAtIndex_25, param=code_block_73)
rotate_4 = Geometry.Rotate(geometry=getItemAtIndex_25, origin=pointAtParameter_5, axis=ZAxis_8, degrees=code_block_74)
startPoint_5 = Curve.StartPoint(curve=rotate_4)
endPoint_4 = Curve.EndPoint(curve=rotate_4)
byStartPointEndPoint_4 = Line.ByStartPointEndPoint(startPoint=startPoint_5, endPoint=endPoint_4)

filterByBoolMask_8 = List.FilterByBoolMask(list=fromDynamoSurface, mask=isNull)

# group (continued): Find Duct References
groupByKey_4 = List.GroupByKey(list=filterByBoolMask_8.out, keys=formula_13)
sortByKey_3 = List.SortByKey(list=groupByKey_4.groups, keys=groupByKey_4.unique_keys)
X_9 = List.GetItemAtIndex(list=sortByKey_3.sorted_list, index=code_block_66)
Y_9 = List.GetItemAtIndex(list=sortByKey_3.sorted_list, index=code_block_75)

# group: Filter by XY direction
XAxis_4 = Vector.XAxis()
YAxis_4 = Vector.YAxis()
ZAxis_10 = Vector.ZAxis()
list_create_7 = List.Create(item0=XAxis_4, item1=YAxis_4, item2=ZAxis_10)
isParallel_5 = Vector.IsParallel(vector=direction_5, other=list_create_7, lacing=CrossProduct)
code_block_84 = CodeBlock { false; }
allIndicesOf_15 = List.AllIndicesOf(list=isParallel_5@L2, item=code_block_84)
count_7 = List.Count(list=allIndicesOf_15@L2)
code_block_85 = CodeBlock { 3; }
eq_12 = count_7 == code_block_85
code_block_86 = CodeBlock { true; }
allIndicesOf_16 = List.AllIndicesOf(list=isParallel_5@L2, item=code_block_86)
flatten_22 = List.Flatten(list=allIndicesOf_16)
formula_14 = Formula("if(x=true,2,y)", x=eq_12, y=flatten_22, lacing=Longest)
groupByKey_5 = List.GroupByKey(list=getItemAtIndex_21, keys=formula_14)
sortByKey_4 = List.SortByKey(list=groupByKey_5.groups, keys=groupByKey_5.unique_keys)
code_block_87 = CodeBlock { 1; }
X_10 = List.GetItemAtIndex(list=sortByKey_4.sorted_list, index=code_block_87)
code_block_88 = CodeBlock { 0; }
Y_10 = List.GetItemAtIndex(list=sortByKey_4.sorted_list, index=code_block_88)

# group (continued): Find Duct References
groupByKey_6 = List.GroupByKey(list=getItemAtIndex_20, keys=formula_14)
sortByKey_5 = List.SortByKey(list=groupByKey_6.groups, keys=groupByKey_6.unique_keys)
X_11 = List.GetItemAtIndex(list=sortByKey_5.sorted_list, index=code_block_69)
distanceTo_4 = Geometry.DistanceTo(geometry=X_8, other=X_10, lacing=CrossProduct)
minimumItem_5 = List.MinimumItem(list=distanceTo_4)
allIndicesOf_17 = List.AllIndicesOf(list=distanceTo_4@L2, item=minimumItem_5)
flatten_23 = List.Flatten(list=allIndicesOf_17@@L3)
getItemAtIndex_26 = List.GetItemAtIndex(list=flatten_23@L2, index=code_block_70)
getItemAtIndex_27 = List.GetItemAtIndex(list=X_11, index=getItemAtIndex_26)
list_create_8 = List.Create(item0=X_9, item1=getItemAtIndex_27)
count_8 = List.Count(list=getItemAtIndex_27)
code_block_89 = CodeBlock(x=count_8) { 0..x-1; }
getItemAtIndex_28 = List.GetItemAtIndex(list=code_block_89@L1, index=code_block_89, lacing=CrossProduct)
flatten_24 = List.Flatten(list=getItemAtIndex_28@L1)
flatten_25 = List.Flatten(list=flatten_24@L1)
getItemAtIndex_29 = List.GetItemAtIndex(list=list_create_8@L4, index=flatten_25, lacing=CrossProduct)
flatten_26 = List.Flatten(list=getItemAtIndex_29@L2)
dimension_byreferences = Custom[Dimension ByReferences](view=activeView_3, line=byStartPointEndPoint_3@L2, references=flatten_26@L2)  # package Genius Loci; Creates a new linear dimension from at least two geometric references of an object.
Y_11 = List.GetItemAtIndex(list=sortByKey_5.sorted_list, index=code_block_76)
distanceTo_5 = Geometry.DistanceTo(geometry=Y_8, other=Y_10, lacing=CrossProduct)
minimumItem_6 = List.MinimumItem(list=distanceTo_5)
allIndicesOf_18 = List.AllIndicesOf(list=distanceTo_5@L2, item=minimumItem_6)
flatten_27 = List.Flatten(list=allIndicesOf_18@@L3)
getItemAtIndex_30 = List.GetItemAtIndex(list=flatten_27@L2, index=code_block_77)
getItemAtIndex_31 = List.GetItemAtIndex(list=Y_11, index=getItemAtIndex_30)
list_create_9 = List.Create(item0=Y_9, item1=getItemAtIndex_31)
count_9 = List.Count(list=getItemAtIndex_31)
code_block_90 = CodeBlock(x=count_9) { 0..x-1; }
getItemAtIndex_32 = List.GetItemAtIndex(list=code_block_90@L1, index=code_block_90, lacing=CrossProduct)
flatten_28 = List.Flatten(list=getItemAtIndex_32@L1)
flatten_29 = List.Flatten(list=flatten_28@L1)
getItemAtIndex_33 = List.GetItemAtIndex(list=list_create_9@L4, index=flatten_29, lacing=CrossProduct)
flatten_30 = List.Flatten(list=getItemAtIndex_33@L2)
dimension_byreferences_2 = Custom[Dimension ByReferences](view=activeView_5, line=byStartPointEndPoint_4@L2, references=flatten_30@L2)

value = Dimension.Value(dimension=dimension_byreferences)

# group: Find Duct References
current_6 = Document.Current()
activeView_6 = Document.ActiveView(document=current_6)
categories_8 = Categories("OST_Walls")
current_7 = Document.Current()
activeView_7 = Document.ActiveView(document=current_7)
code_block_91 = CodeBlock { 2; }
code_block_92 = CodeBlock { 0; }
code_block_93 = CodeBlock { 1; }
ZAxis_11 = Vector.ZAxis()
reverse_3 = Vector.Reverse(vector=ZAxis_11)
code_block_94 = CodeBlock { 0.5; }
XAxis_5 = Vector.XAxis()
YAxis_5 = Vector.YAxis()
ZAxis_12 = Vector.ZAxis()
list_create_10 = List.Create(item0=XAxis_5, item1=YAxis_5, item2=ZAxis_12)
code_block_95 = CodeBlock { false; }
code_block_96 = CodeBlock { 3; }
code_block_97 = CodeBlock { true; }
code_block_98 = CodeBlock { 0; }
code_block_99 = CodeBlock { 0; }
code_block_100 = CodeBlock { 1; }
code_block_101 = CodeBlock { 0.5; }
ZAxis_13 = Vector.ZAxis()
code_block_102 = CodeBlock { 90; }
code_block_103 = CodeBlock { 0; }
code_block_104 = CodeBlock { true; }
code_block_105 = CodeBlock { 0; }
XAxis_6 = Vector.XAxis()
YAxis_6 = Vector.YAxis()
ZAxis_14 = Vector.ZAxis()
list_create_11 = List.Create(item0=XAxis_6, item1=YAxis_6, item2=ZAxis_14)
code_block_106 = CodeBlock { false; }
code_block_107 = CodeBlock { 3; }
code_block_108 = CodeBlock { true; }
code_block_109 = CodeBlock { 1; }
code_block_110 = CodeBlock { 1; }
code_block_111 = CodeBlock { 0; }
current_8 = Document.Current()
activeView_8 = Document.ActiveView(document=current_8)
code_block_112 = CodeBlock { 1; }
code_block_113 = CodeBlock { 0; }
code_block_114 = CodeBlock { 1; }
code_block_115 = CodeBlock { 0.5; }
ZAxis_15 = Vector.ZAxis()
code_block_116 = CodeBlock { 90; }
code_block_117 = CodeBlock { 1; }
code_block_118 = CodeBlock { 0; }
code_block_119 = CodeBlock { 0; }
code_block_120 = CodeBlock { 0; }

formula_15 = Formula("if(x=true,y,false)", x=eq_9, y=categories_8)

# group (continued): Find Duct References
all_elements_of_category_in_view_3 = ElementsOfCategoryInView(Category=formula_15, View=activeView_7)
wall_edges_references_2 = Custom[Wall Edges References](wall=all_elements_of_category_in_view_3)
distanceTo_6 = Geometry.DistanceTo(geometry=translate_2, other=wall_edges_references_2.Exterior_Side_Horizontal_Edges@L1, lacing=CrossProduct)
round_4 = Math.Round(number=distanceTo_6, digits=code_block_91)
formula_16 = Formula("if(x=0,100000000,x)", x=round_4)
minimumItem_7 = List.MinimumItem(list=formula_16)
minimumItem_8 = List.MinimumItem(list=minimumItem_7)
allIndicesOf_19 = List.AllIndicesOf(list=round_4@@L2, item=minimumItem_8)
flatten_31 = List.Flatten(list=allIndicesOf_19@@L4)
getItemAtIndex_34 = List.GetItemAtIndex(list=flatten_31@L2, index=code_block_92)
chop_4 = List.Chop(list=getItemAtIndex_34, lengths=code_block_93)
getItemAtIndex_35 = List.GetItemAtIndex(list=filterByBoolMask_5.in@L2, index=chop_4@L2)
flatten_32 = List.Flatten(list=getItemAtIndex_35)
pointAtParameter_6 = Surface.PointAtParameter(surface=flatten_32, u=code_block_94, v=code_block_94)
Z_3 = Point.Z(point=pointAtParameter_6)
translate_4 = Geometry.Translate(geometry=flatten_32, direction=reverse_3, distance=Z_3)
normalAtPoint_2 = Surface.NormalAtPoint(surface=flatten_32, point=pointAtParameter_6)
fromDynamoSurface_2 = Custom[RevitFaceReference.FromDynamoSurface](DynamoSurface=flatten_32)
flatten_33 = List.Flatten(list=wall_edges_references_2.Exterior_Side_Horizontal_References)
flatten_34 = List.Flatten(list=wall_edges_references_2.Exterior_Side_Horizontal_Edges)
startPoint_6 = Curve.StartPoint(curve=flatten_34)
X_12 = Point.X(point=startPoint_6)
Y_12 = Point.Y(point=startPoint_6)
byCoordinates_4 = Point.ByCoordinates(x=X_12, y=Y_12)
endPoint_5 = Curve.EndPoint(curve=flatten_34)
X_13 = Point.X(point=endPoint_5)
Y_13 = Point.Y(point=endPoint_5)
byCoordinates_5 = Point.ByCoordinates(x=X_13, y=Y_13)
byStartPointEndPoint_5 = Line.ByStartPointEndPoint(startPoint=byCoordinates_4, endPoint=byCoordinates_5)
string_from_object_4 = FromObject(obj=byStartPointEndPoint_5)
eq_13 = string_from_object_4 == string_from_object_4  # lacing=CrossProduct
allIndicesOf_20 = List.AllIndicesOf(list=eq_13@L2, item=code_block_104)
getItemAtIndex_36 = List.GetItemAtIndex(list=allIndicesOf_20@L2, index=code_block_105)
uniqueItems_5 = List.UniqueItems(list=getItemAtIndex_36)
getItemAtIndex_37 = List.GetItemAtIndex(list=flatten_33, index=uniqueItems_5)
getItemAtIndex_38 = List.GetItemAtIndex(list=byStartPointEndPoint_5, index=uniqueItems_5)
direction_6 = Line.Direction(line=getItemAtIndex_38)
isParallel_6 = Vector.IsParallel(vector=direction_6, other=list_create_11, lacing=CrossProduct)
allIndicesOf_21 = List.AllIndicesOf(list=isParallel_6@L2, item=code_block_106)
count_10 = List.Count(list=allIndicesOf_21@L2)
eq_14 = count_10 == code_block_107
allIndicesOf_22 = List.AllIndicesOf(list=isParallel_6@L2, item=code_block_108)
flatten_35 = List.Flatten(list=allIndicesOf_22)
formula_17 = Formula("if(x=true,2,y)", x=eq_14, y=flatten_35, lacing=Longest)
groupByKey_7 = List.GroupByKey(list=getItemAtIndex_37, keys=formula_17)
sortByKey_6 = List.SortByKey(list=groupByKey_7.groups, keys=groupByKey_7.unique_keys)
X_14 = List.GetItemAtIndex(list=sortByKey_6.sorted_list, index=code_block_109)
groupByKey_8 = List.GroupByKey(list=getItemAtIndex_38, keys=formula_17)
sortByKey_7 = List.SortByKey(list=groupByKey_8.groups, keys=groupByKey_8.unique_keys)
X_15 = List.GetItemAtIndex(list=sortByKey_7.sorted_list, index=code_block_110)
Y_14 = List.GetItemAtIndex(list=sortByKey_6.sorted_list, index=code_block_118)
Y_15 = List.GetItemAtIndex(list=sortByKey_7.sorted_list, index=code_block_119)

isNull_2 = Object.IsNull(obj=normalAtPoint_2)
filterByBoolMask_9 = List.FilterByBoolMask(list=translate_4, mask=isNull_2)
filterByBoolMask_10 = List.FilterByBoolMask(list=normalAtPoint_2, mask=isNull_2)

# group (continued): Find Duct References
isParallel_7 = Vector.IsParallel(vector=filterByBoolMask_10.out, other=list_create_10, lacing=CrossProduct)
allIndicesOf_23 = List.AllIndicesOf(list=isParallel_7@L2, item=code_block_95)
count_11 = List.Count(list=allIndicesOf_23@L2)
eq_15 = count_11 == code_block_96
allIndicesOf_24 = List.AllIndicesOf(list=isParallel_7@L2, item=code_block_97)
flatten_36 = List.Flatten(list=allIndicesOf_24)
formula_18 = Formula("if(x=true,2,y)", x=eq_15, y=flatten_36, lacing=Longest)
groupByKey_9 = List.GroupByKey(list=filterByBoolMask_9.out, keys=formula_18)
sortByKey_8 = List.SortByKey(list=groupByKey_9.groups, keys=groupByKey_9.unique_keys)
X_16 = List.GetItemAtIndex(list=sortByKey_8.sorted_list, index=code_block_98)
perimeterCurves_3 = Surface.PerimeterCurves(surface=X_16)
length_3 = Curve.Length(curve=perimeterCurves_3)
maximumItem_7 = List.MaximumItem(list=length_3)
allIndicesOf_25 = List.AllIndicesOf(list=length_3@L2, item=maximumItem_7)
flatten_37 = List.Flatten(list=allIndicesOf_25@@L3)
getItemAtIndex_39 = List.GetItemAtIndex(list=flatten_37@L2, index=code_block_99)
chop_5 = List.Chop(list=getItemAtIndex_39, lengths=code_block_100)
getItemAtIndex_40 = List.GetItemAtIndex(list=perimeterCurves_3@L2, index=chop_5@L2)
pointAtParameter_7 = Curve.PointAtParameter(curve=getItemAtIndex_40, param=code_block_101)
rotate_5 = Geometry.Rotate(geometry=getItemAtIndex_40, origin=pointAtParameter_7, axis=ZAxis_13, degrees=code_block_102)
startPoint_7 = Curve.StartPoint(curve=rotate_5)
endPoint_6 = Curve.EndPoint(curve=rotate_5)
byStartPointEndPoint_6 = Line.ByStartPointEndPoint(startPoint=startPoint_7, endPoint=endPoint_6)
distanceTo_7 = Geometry.DistanceTo(geometry=X_16, other=X_15, lacing=CrossProduct)
minimumItem_9 = List.MinimumItem(list=distanceTo_7)
allIndicesOf_26 = List.AllIndicesOf(list=distanceTo_7@L2, item=minimumItem_9)
flatten_38 = List.Flatten(list=allIndicesOf_26@@L3)
getItemAtIndex_41 = List.GetItemAtIndex(list=flatten_38@L2, index=code_block_111)
getItemAtIndex_42 = List.GetItemAtIndex(list=X_14, index=getItemAtIndex_41)
count_12 = List.Count(list=getItemAtIndex_42)
code_block_121 = CodeBlock(x=count_12) { 0..x-1; }
getItemAtIndex_43 = List.GetItemAtIndex(list=code_block_121@L1, index=code_block_121, lacing=CrossProduct)
flatten_39 = List.Flatten(list=getItemAtIndex_43@L1)
flatten_40 = List.Flatten(list=flatten_39@L1)
Y_16 = List.GetItemAtIndex(list=sortByKey_8.sorted_list, index=code_block_112)
perimeterCurves_4 = Surface.PerimeterCurves(surface=Y_16)
length_4 = Curve.Length(curve=perimeterCurves_4)
maximumItem_8 = List.MaximumItem(list=length_4)
allIndicesOf_27 = List.AllIndicesOf(list=length_4@L2, item=maximumItem_8)
flatten_41 = List.Flatten(list=allIndicesOf_27@@L3)
getItemAtIndex_44 = List.GetItemAtIndex(list=flatten_41@L2, index=code_block_113)
chop_6 = List.Chop(list=getItemAtIndex_44, lengths=code_block_114)
getItemAtIndex_45 = List.GetItemAtIndex(list=perimeterCurves_4@L2, index=chop_6@L2)
pointAtParameter_8 = Curve.PointAtParameter(curve=getItemAtIndex_45, param=code_block_115)
rotate_6 = Geometry.Rotate(geometry=getItemAtIndex_45, origin=pointAtParameter_8, axis=ZAxis_15, degrees=code_block_116)
startPoint_8 = Curve.StartPoint(curve=rotate_6)
endPoint_7 = Curve.EndPoint(curve=rotate_6)
byStartPointEndPoint_7 = Line.ByStartPointEndPoint(startPoint=startPoint_8, endPoint=endPoint_7)
distanceTo_8 = Geometry.DistanceTo(geometry=Y_16, other=Y_15, lacing=CrossProduct)
minimumItem_10 = List.MinimumItem(list=distanceTo_8)
allIndicesOf_28 = List.AllIndicesOf(list=distanceTo_8@L2, item=minimumItem_10)
flatten_42 = List.Flatten(list=allIndicesOf_28@@L3)
getItemAtIndex_46 = List.GetItemAtIndex(list=flatten_42@L2, index=code_block_120)
getItemAtIndex_47 = List.GetItemAtIndex(list=Y_14, index=getItemAtIndex_46)
count_13 = List.Count(list=getItemAtIndex_47)
code_block_122 = CodeBlock(x=count_13) { 0..x-1; }
getItemAtIndex_48 = List.GetItemAtIndex(list=code_block_122@L1, index=code_block_122, lacing=CrossProduct)
flatten_43 = List.Flatten(list=getItemAtIndex_48@L1)
flatten_44 = List.Flatten(list=flatten_43@L1)

filterByBoolMask_11 = List.FilterByBoolMask(list=fromDynamoSurface_2, mask=isNull_2)

# group (continued): Find Duct References
groupByKey_10 = List.GroupByKey(list=filterByBoolMask_11.out, keys=formula_18)
sortByKey_9 = List.SortByKey(list=groupByKey_10.groups, keys=groupByKey_10.unique_keys)
X_17 = List.GetItemAtIndex(list=sortByKey_9.sorted_list, index=code_block_103)
list_create_12 = List.Create(item0=X_17, item1=getItemAtIndex_42)
getItemAtIndex_49 = List.GetItemAtIndex(list=list_create_12@L4, index=flatten_40, lacing=CrossProduct)
flatten_45 = List.Flatten(list=getItemAtIndex_49@L2)
dimension_byreferences_3 = Custom[Dimension ByReferences](view=activeView_6, line=byStartPointEndPoint_6@L2, references=flatten_45@L2)
Y_17 = List.GetItemAtIndex(list=sortByKey_9.sorted_list, index=code_block_117)
list_create_13 = List.Create(item0=Y_17, item1=getItemAtIndex_47)
getItemAtIndex_50 = List.GetItemAtIndex(list=list_create_13@L4, index=flatten_44, lacing=CrossProduct)
flatten_46 = List.Flatten(list=getItemAtIndex_50@L2)
dimension_byreferences_4 = Custom[Dimension ByReferences](view=activeView_8, line=byStartPointEndPoint_7@L2, references=flatten_46@L2)

value_2 = Dimension.Value(dimension=dimension_byreferences_3)
gt_2 = value > value_2
formula_19 = Formula("if(x=true,y,z)", x=gt_2, y=dimension_byreferences, z=dimension_byreferences_3)
delete = Element.Delete(element=formula_19)
value_3 = Dimension.Value(dimension=dimension_byreferences_2)
value_4 = Dimension.Value(dimension=dimension_byreferences_4)
gt_3 = value_3 > value_4
formula_20 = Formula("if(x=true,y,z)", x=gt_3, y=dimension_byreferences_2, z=dimension_byreferences_4)
delete_2 = Element.Delete(element=formula_20)
