# Dynamo graph Create legend.dyn (Dynamo 2.19.3.6394)
# packages: Data-Shapes 2023.2.112, Clockwork for Dynamo 2.x 2.3.0, Genius Loci 2022.9.16, archi-lab.net 2023.213.1722, Synthesize toolkit 12.7.5

# group: UI
code_block = CodeBlock { "Create Legend"; }
# note: Developed by Nenad Kovacevic
# dynamoscripts.com
# Used packages:
# Data-Shapes | v.2023.2.112
# Clockwork |
# GeniusLoci | v.2022.9.16
# archilab |
# Synthesize |
code_block_2 = CodeBlock { "Select elements"; }
# note: Custom Node: Data-Shapesv.2023.2.112
selectmodelelements_data = Custom[SelectModelElements Data](InputName=code_block_2)  # package Data-Shapes; Creates a Revit element selection input for UI.MultipleInputForm++ . Check out www.data-shapes.net for more infos!
code_block_3 = CodeBlock { "Include lines?"; "Yes"; }
boolean = BoolSelector(true)
boolean_input = Custom[Boolean input](InputName=code_block_3.out0, DefaultValue=boolean, SideText=code_block_3.out1)  # package Data-Shapes; Creates a boolean input for UI.MultipleInputForm ++ . Check out www.data-shapes.net for more infos!
code_block_4 = CodeBlock { "Text style"; }
text_type = Python()  # IronPython2; unwired: IN[0]
# ---------- text_type.python (33 lines) ----------
import clr
clr.AddReference('RevitAPI')
from Autodesk.Revit.DB import *

clr.AddReference("RevitServices")
import RevitServices
from RevitServices.Persistence import DocumentManager

def TextNoteTypesAndNames(doc):
    # Collect all text note types (styles)
    collector = FilteredElementCollector(doc).OfClass(TextNoteType).WhereElementIsElementType()
    textNoteTypes = collector.ToElements()

    # Lists to store types and their names
    types = []
    names = []

    for textNoteType in textNoteTypes:
        try:
            types.append(textNoteType)  # Store the type
            names.append(textNoteType.get_Parameter(BuiltInParameter.ALL_MODEL_TYPE_NAME).AsString())  # Store the type's name
        except Exception as e:
            # Handle any exceptions that occur while accessing properties
            names.append("Error: " + str(e))

    return types, names

# Get the current document
doc = DocumentManager.Instance.CurrentDBDocument

# Collect TextNote types and their names from the current document
types, names = TextNoteTypesAndNames(doc)
OUT = [types, names]
# ----------------------------------------
code_block_5 = CodeBlock(x=text_type) { x[0]; x[1]; }
dropdown_data = Custom[DropDown Data](InputName=code_block_4, Keys=code_block_5.out1, Values=code_block_5.out0)  # package Data-Shapes; Create data for DropDown input in UI.MultiInputForm ++ . Check out www.data-shapes.net for more infos.
code_block_6 = CodeBlock { "Adjust vertical distance:"; }
code_block_7 = CodeBlock { "0"; }
textbox_data = Custom[TextBox Data](InputName=code_block_6, DefaultText=code_block_7, IsNumberEntry=boolean)  # package Data-Shapes; Create Data for TextBox input in UI.MultipleInputForm ++ . Check out www.data-shapes.net for more informations
list_create = List.Create(item0=selectmodelelements_data, item1=boolean_input, item2=dropdown_data, item3=textbox_data)
boolean_2 = BoolSelector(true)
code_block_8 = CodeBlock { 200; }
multipleinputform = Custom[MultipleInputForm ++](ButtonText_optional=code_block, Inputs=list_create, Toggle=boolean_2, LabelWidth_optional=code_block_8)  # package Data-Shapes; Create a form with multiple inputs. see www.data-shapes.net for tutorials and infos!

code_block_9 = CodeBlock(x=multipleinputform.User_Inputs) { x[1]; }

# group: Filter elements
code_block_10 = CodeBlock(x=multipleinputform.User_Inputs) { x[0]; }
collect_elements = Python()  # CPython3; unwired: IN[0]
# ---------- collect_elements.python (25 lines) ----------
import clr
# Import RevitAPI
clr.AddReference('RevitAPI')
from Autodesk.Revit.DB import FilteredElementCollector, ViewType

# Import DocumentManager
clr.AddReference('RevitServices')
from RevitServices.Persistence import DocumentManager

# Get the current document and active view
doc = DocumentManager.Instance.CurrentDBDocument
activeView = doc.ActiveView

# Ensure the active view is a legend
if activeView.ViewType != ViewType.Legend:
    raise Exception("The active view is not a legend.")

# Collect all elements in the active legend view
elementsInLegend = FilteredElementCollector(doc, activeView.Id).ToElements()

# Exclude the first element (index 0)
elementsInLegend = elementsInLegend[1:]

# Output the remaining elements
OUT = elementsInLegend
# ----------------------------------------
# note: Custom Node: Clockwork
passthrough = Custom[Passthrough](passThrough=code_block_10, waitFor=collect_elements)  # package Clockwork for Dynamo 2.x; Forces a sequential order of execution. The node wired into the output of the Passthrough node will be executed *after* the node wired into the waitFor input (e.g. important for some Revit operations). The value of the passThrough input will be passed on to the node wired into the output port of the Passthrough node.
elementType = Element.ElementType(element=passthrough)
flatten = List.Flatten(list=elementType)
code_block_11 = CodeBlock(x=collect_elements) { x; }

uniqueItems = List.UniqueItems(list=flatten)
family_type_to_instance = Python(IN[0]=uniqueItems)  # CPython3
# ---------- family_type_to_instance.python (33 lines) ----------
import clr
# Import RevitAPI
clr.AddReference('RevitAPI')
from Autodesk.Revit.DB import *

# Import DocumentManager
clr.AddReference('RevitServices')
import RevitServices
from RevitServices.Persistence import DocumentManager

# Inputs from Dynamo
familyTypes = IN[0]  # List of family types

# Get the current Revit document
doc = DocumentManager.Instance.CurrentDBDocument

def find_first_instance_of_type(familyTypeId):
    # Convert integer ID to ElementId if necessary
    if isinstance(familyTypeId, int):
        familyTypeId = ElementId(familyTypeId)

    # Find instances of the given family type in the Revit model
    collector = FilteredElementCollector(doc).OfClass(FamilyInstance)
    for elem in collector:
        if elem.Symbol.Id == familyTypeId:
            return elem
    return None

# Find the first instance of each family type
firstInstances = [find_first_instance_of_type(ft.Id) for ft in familyTypes]

# Assign the first found instance of each type to the OUT variable
OUT = firstInstances
# ----------------------------------------
geometry = Element.Geometry(element=family_type_to_instance)
# note: Custom Node: Synthesize
solid_byunion_fixer = Custom[Solid.ByUnion Fixer](VARsolids=geometry@L2)  # package Synthesize toolkit; Solid.ByUnion Fixer
filter_geometry = Python(IN[0]=solid_byunion_fixer)  # CPython3
# ---------- filter_geometry.python (44 lines) ----------
import clr
clr.AddReference('ProtoGeometry')
from Autodesk.DesignScript.Geometry import Solid, Line, BoundingBox

# Input: Assuming IN[0] is the list with sublists
input_list = IN[0]

def get_largest_geometry(geometries):
    # Function to determine the largest or most suitable geometry
    # for creating a bounding box when no solids are present
    largest_geometry = None
    largest_volume = -1

    for geometry in geometries:
        if isinstance(geometry, Line):
            # Use line length as a measure
            size_measure = geometry.Length
        elif hasattr(geometry, 'Area'):
            # Use area as a measure for planar geometries
            size_measure = geometry.Area
        else:
            # Default to a small value if size measure is not defined
            size_measure = 0
        
        if size_measure > largest_volume:
            largest_volume = size_measure
            largest_geometry = geometry

    return largest_geometry

def process_sublist(sublist):
    solids = [geom for geom in sublist if isinstance(geom, Solid)]
    if solids:
        union_solid = solids[0]
        return union_solid
    else:
        # No solids, find the largest or most suitable geometry
        return get_largest_geometry(sublist)

# Process each sublist
processed_list = [process_sublist(sublist) for sublist in input_list]

# Output
OUT = processed_list
# ----------------------------------------
byGeometry = BoundingBox.ByGeometry(geom=filter_geometry@L1)
code_block_12 = CodeBlock(x=multipleinputform.User_Inputs) { x[3]; }
code_block_13 = CodeBlock(x=code_block_12) { x; }

# group: Insert elements
current = Document.Current()
activeView = Document.ActiveView(document=current)
adjust_location = Python(IN[0]=byGeometry, IN[1]=code_block_13)  # IronPython2
# ---------- adjust_location.python (34 lines) ----------
# Importing required class
import clr
clr.AddReference('ProtoGeometry')
from Autodesk.DesignScript.Geometry import Point

# Assuming IN[0] is a list of bounding boxes (each with Min and Max properties) and IN[1] is the distance between elements
bounding_boxes = IN[0]
distance_between = IN[1]

# Function to calculate the 'effective height' of a bounding box based on its largest X or Y dimension
def calculate_effective_height(bbox):
    x_diff = abs(bbox.MaxPoint.X - bbox.MinPoint.X)
    y_diff = abs(bbox.MaxPoint.Y - bbox.MinPoint.Y)
    return max(x_diff, y_diff)

# Determine the maximum height from all bounding boxes
max_height = max(calculate_effective_height(bbox) for bbox in bounding_boxes)

# Initialize the starting Y position and an empty list to store the points
current_y = 0
points = []

# Iterate through each bounding box
for bbox in bounding_boxes:
    # Create a point with X and Z as 0, and Y as the current Y position
    point = Point.ByCoordinates(0, current_y, 0)
    points.append(point)

    # Update the current Y position for the next box
    # It's the current Y position plus the maximum height and the specified distance
    current_y += max_height + distance_between

# Output the list of points
OUT = points
# ----------------------------------------
# note: Custom Node: GeniusLociv.2022.9.16
create_legend_component = Custom[Create Legend Component](view=activeView, familyType=uniqueItems, location=adjust_location)  # package Genius Loci; Inserts a new legend component by duplicating an existing in the given legend view. Please note : At least one legend component must be placed in the legend view.
# note: Custom Node: Synthesize
dimensions = Custom[ZK.BoundingBox.Dimensions](VARBoundingBox=byGeometry)  # package Synthesize toolkit; Input Bounding Box element to get its dimensions (Width, Length, Height). Setting Boolean switch to True rounds output values.
maximumItem = List.MaximumItem(list=dimensions.VARWidth)
Y = Point.Y(point=adjust_location)
byCoordinates = Point.ByCoordinates(x=maximumItem, y=Y)

geometry_2 = Element.Geometry(element=create_legend_component)
solid_byunion_fixer_2 = Custom[Solid.ByUnion Fixer](VARsolids=geometry_2@L2)
filter_geometry_2 = Python(IN[0]=solid_byunion_fixer_2)  # CPython3
# ---------- filter_geometry_2.python (49 lines) ----------
import clr
clr.AddReference('ProtoGeometry')
from Autodesk.DesignScript.Geometry import *

# Input: Assuming IN[0] is the list with sublists
input_list = IN[0]

def get_largest_geometry(geometries):
    # Function to determine the largest geometry
    largest_geometry = None
    largest_size = -1

    for geometry in geometries:
        if isinstance(geometry, Solid):
            # Use volume as a measure for solids
            size_measure = geometry.Volume
        elif isinstance(geometry, Surface):
            # Use area as a measure for surfaces
            size_measure = geometry.Area
        elif isinstance(geometry, Curve):
            # Use length as a measure for curves
            size_measure = geometry.Length
        else:
            # Skip other types or set to a small value
            size_measure = 0

        if size_measure > largest_size:
            largest_size = size_measure
            largest_geometry = geometry

    return largest_geometry

def process_sublist(sublist):
    # Filter out Meshes
    filtered_geometries = [geom for geom in sublist if not isinstance(geom, Mesh)]
    
    # If there are solids, find the largest solid
    solids = [geom for geom in filtered_geometries if isinstance(geom, Solid)]
    if solids:
        return get_largest_geometry(solids)
    else:
        # No solids, find the largest or most suitable geometry
        return get_largest_geometry(filtered_geometries)

# Process each sublist
processed_list = [process_sublist(sublist) for sublist in input_list]

# Output
OUT = processed_list
# ----------------------------------------
byGeometry_2 = BoundingBox.ByGeometry(geom=filter_geometry_2@L1)

# group: Text values
name = Element.Name(element=uniqueItems)

code_block_14 = CodeBlock(x=multipleinputform.User_Inputs) { x[2]; }
code_block_15 = CodeBlock(x=code_block_14) { x; }

# group: Insert text
code_block_16 = CodeBlock { "Left"; }
byLocation = TextNote.ByLocation(view=activeView, location=byCoordinates, text=name, alignment=code_block_16, type=code_block_15)
end = Revit.Transaction.Transaction.End(input=byLocation)
adjust_vertcal_align = Python(IN[0]=byLocation)  # CPython3
# ---------- adjust_vertcal_align.python (38 lines) ----------
import clr

# Import DocumentManager and TransactionManager
clr.AddReference('RevitServices')
from RevitServices.Persistence import DocumentManager
from RevitServices.Transactions import TransactionManager

# Import Revit API
clr.AddReference('RevitAPI')
from Autodesk.Revit.DB import *

# Get the current document
doc = DocumentManager.Instance.CurrentDBDocument

# Define the text notes to adjust (assumed to be passed in from Dynamo)
textNotes = UnwrapElement(IN[0])

# Start a transaction
TransactionManager.Instance.EnsureInTransaction(doc)

try:
    for textNote in textNotes:
        # Check if the object is a TextNote
        if isinstance(textNote, TextNote):
            # Change vertical alignment to Middle
            textNote.VerticalAlignment = VerticalTextAlignment.Middle

    # If successful, set the output to True
    result = True
except Exception as e:
    # If there is an error, print the error message
    result = str(e)

# End the transaction
TransactionManager.Instance.TransactionTaskDone()

# Output
OUT = result
# ----------------------------------------

# group: Insert lines
code_block_17 = CodeBlock(x=code_block_9) { x; }
start = Revit.Transaction.Transaction.Start(input=end)
# note: Custom Node: archilab
width = archilab.Revit.Elements.TextNotes.Width(textNote=start)
maximumItem_2 = List.MaximumItem(list=width)
length_unit = Python()  # CPython3; unwired: IN[0]
# ---------- length_unit.python (39 lines) ----------
import clr
clr.AddReference("RevitServices")
import RevitServices
from RevitServices.Persistence import DocumentManager
from Autodesk.Revit.DB import *

# Function to map unit labels to abbreviations
def map_unit_label_to_abbr(unit_label):
    unit_abbr_map = {
        'Feet': 'ft',
        'Meters': 'm',
        'Centimeters': 'cm',
        'Millimeters': 'mm'
        # Add other mappings as needed
    }
    return unit_abbr_map.get(unit_label, 'Unknown')

# Get the current document
inputdoc = UnwrapElement(IN[0]) if isinstance(IN[0], list) else [UnwrapElement(IN[0])][0]
doc = DocumentManager.Instance.CurrentDBDocument if inputdoc is None else inputdoc

# Get the Revit version
version = int(DocumentManager.Instance.CurrentUIApplication.Application.VersionNumber)

length_unit_abbr = 'Unknown'

if version < 2021:
    # For Revit versions before 2021
    formatOption = doc.GetUnits().GetFormatOptions(UnitType.UT_Length)
    dispUnitLabel = LabelUtils.GetLabelFor(formatOption.DisplayUnits)
    length_unit_abbr = map_unit_label_to_abbr(dispUnitLabel)
else:
    # For Revit 2021 and later
    formatOption = doc.GetUnits().GetFormatOptions(SpecTypeId.Length)
    symUnit = formatOption.GetUnitTypeId()
    dispUnitLabel = LabelUtils.GetLabelForUnit(symUnit)
    length_unit_abbr = map_unit_label_to_abbr(dispUnitLabel)

OUT = length_unit_abbr
# ----------------------------------------
python_script = Python(IN[0]=byGeometry_2, IN[1]=byCoordinates, IN[2]=name, IN[3]=maximumItem_2, IN[4]=length_unit)  # CPython3
# ---------- python_script.python (99 lines) ----------
import clr
clr.AddReference('ProtoGeometry')
clr.AddReference('RevitAPI')
clr.AddReference('RevitNodes')
clr.AddReference('RevitServices')

from Autodesk.DesignScript.Geometry import *
from Autodesk.Revit.DB import Document, FilteredElementCollector, View
from RevitServices.Persistence import DocumentManager

# Inputs
bounding_boxes = IN[0]  # Bounding boxes of elements
text_locations = IN[1]  # Locations of text descriptions
text_contents = IN[2]  # Contents of text descriptions
max_width = IN[3]    # Widths of text descriptions
unit_type = IN[4]      # Unit type ('ft', 'm', 'mm', 'cm')

# Get the current document and active view
doc = DocumentManager.Instance.CurrentDBDocument
active_view = doc.ActiveView

# Get the scale of the active view
view_scale = active_view.Scale

# Constants for conversion
CONVERSION_FACTORS = {
    'ft': 1,            # Feet to feet
    'm': 0.3048,       # Meters to feet
    'mm': 304.8,   # Millimeters to feet
    'cm': 30.48     # Centimeters to feet
}
OFFSET_MULTIPLIER = 1.2  # Offset to ensure enough space


# Function to estimate text width
def estimate_text_width():
    # Convert to feet based on the unit type and apply scale and offset
    return max_width * CONVERSION_FACTORS.get(unit_type, 1) * view_scale * OFFSET_MULTIPLIER

# Function to calculate the extended width for each element and overall bounding box
def calculate_extended_width_and_bounding_box(bounding_boxes, text_locations, text_contents):
    min_x = min_y = float('inf')
    max_x = max_y = float('-inf')

    for box in bounding_boxes:
        min_x = min(min_x, box.MinPoint.X)
        min_y = min(min_y, box.MinPoint.Y)
        max_y = max(max_y, box.MaxPoint.Y)

    text_width_estimate = estimate_text_width()

    # Find the leftmost text location
    leftmost_text_x = min(text_loc.X for text_loc in text_locations)
    
    # Set final_max_x based on the actual text width
    final_max_x = max(max(box.MaxPoint.X for box in bounding_boxes), leftmost_text_x + text_width_estimate)

    # Place the vertical line before the leftmost text location
    max_element_x = max(box.MaxPoint.X for box in bounding_boxes)
    vertical_mid_x = min(leftmost_text_x, max_element_x + (leftmost_text_x - max_element_x) / 2)

    # Adjust the left vertical line to be further left
    left_offset = (max_element_x - min_x) * 1.2
    overall_min_x = min_x - left_offset

    # Add an offset to the top and bottom horizontal lines
    vertical_offset = (max_y - min_y) * 0.05  # 5% offset
    min_y -= vertical_offset
    max_y += vertical_offset

    return (overall_min_x, min_y, final_max_x, max_y, vertical_mid_x)

# Calculate overall bounding box and vertical line position
overall_min_x, overall_min_y, final_max_x, overall_max_y, vertical_mid_x = calculate_extended_width_and_bounding_box(bounding_boxes, text_locations, text_contents)

# Function to create lines
def create_lines(bounding_boxes, overall_min_x, overall_min_y, final_max_x, overall_max_y, vertical_mid_x):
    lines = []

    p1 = Point.ByCoordinates(overall_min_x, overall_min_y)
    p2 = Point.ByCoordinates(final_max_x, overall_min_y)
    p3 = Point.ByCoordinates(final_max_x, overall_max_y)
    p4 = Point.ByCoordinates(overall_min_x, overall_max_y)
    lines.extend([Line.ByStartPointEndPoint(p1, p2), Line.ByStartPointEndPoint(p2, p3), Line.ByStartPointEndPoint(p3, p4), Line.ByStartPointEndPoint(p4, p1)])

    sorted_boxes = sorted(bounding_boxes, key=lambda box: (box.MinPoint.Y + box.MaxPoint.Y) / 2)
    for i in range(len(sorted_boxes) - 1):
        y = (sorted_boxes[i].MaxPoint.Y + sorted_boxes[i + 1].MinPoint.Y) / 2
        lines.append(Line.ByStartPointEndPoint(Point.ByCoordinates(overall_min_x, y), Point.ByCoordinates(final_max_x, y)))

    lines.append(Line.ByStartPointEndPoint(Point.ByCoordinates(vertical_mid_x, overall_min_y), Point.ByCoordinates(vertical_mid_x, overall_max_y)))

    return lines

# Create lines
all_lines = create_lines(bounding_boxes, overall_min_x, overall_min_y, final_max_x, overall_max_y, vertical_mid_x)

# Assign your output to the OUT variable
OUT = all_lines
# ----------------------------------------
code_block_18 = CodeBlock { "Nenad"; }
if_ = RefactoredIf(test=code_block_17, true=python_script, false=code_block_18)
# note: Custom Node: Clockwork
byCurve = Custom[DetailCurve.ByCurve+](curve=if_, view=activeView)  # package Clockwork for Dynamo 2.x; Creates a detail line based on a given curve. Unlike the OOTB node it can also draw circles.
passthrough_2 = Custom[Passthrough](passThrough=code_block_11, waitFor=start)
delete = Element.Delete(element=passthrough_2)
