# Dynamo graph Dimension_simple.dyn (Dynamo 2.3.0.5885)
# packages: spring nodes 203.2.0, Genius Loci 2020.8.20

# group: Ducts and Walls
categories = Categories("OST_DuctCurves")
all_elements_of_category = ElementsOfCategory(Category=categories)
categories_2 = Categories("OST_Walls")
all_elements_of_category_2 = ElementsOfCategory(Category=categories_2)
geometry = Element.Geometry(element=all_elements_of_category)
flatten = List.Flatten(list=geometry)
geometry_2 = Element.Geometry(element=all_elements_of_category_2)
flatten_2 = List.Flatten(list=geometry_2)
distanceTo = Geometry.DistanceTo(geometry=flatten, other=flatten_2, lacing=CrossProduct)
formula = Formula("if(x=0,100000000,x)", x=distanceTo)
minimumItem = List.MinimumItem(list=formula)
allIndicesOf = List.AllIndicesOf(list=distanceTo@L2, item=minimumItem)
getItemAtIndex = List.GetItemAtIndex(list=all_elements_of_category_2, index=allIndicesOf)
flatten_3 = List.Flatten(list=getItemAtIndex)
list_create = List.Create(item0=all_elements_of_category, item1=flatten_3)
count = List.Count(list=flatten_3)
code_block = CodeBlock(x=count) { 0..x-1; }
getItemAtIndex_2 = List.GetItemAtIndex(list=code_block@L1, index=code_block, lacing=CrossProduct)
flatten_4 = List.Flatten(list=getItemAtIndex_2@L1)
flatten_5 = List.Flatten(list=flatten_4@L1)
getItemAtIndex_3 = List.GetItemAtIndex(list=list_create@L4, index=flatten_5, lacing=CrossProduct)
flatten_6 = List.Flatten(list=getItemAtIndex_3@L2)
wall_edges_references = Custom[Wall Edges References](wall=all_elements_of_category_2)  # package Genius Loci; Get the vertical and horizontal edges and their references from the exterior and interior faces.
code_block_2 = CodeBlock { 0; }
getItemAtIndex_4 = List.GetItemAtIndex(list=wall_edges_references.Interior_Side_Horizontal_Edges, index=code_block_2)
getItemAtIndex_5 = List.GetItemAtIndex(list=getItemAtIndex_4, index=code_block_2)
code_block_3 = CodeBlock { 1000; }
offset = Curve.Offset(curve=getItemAtIndex_5, distance=code_block_3)
startPoint = Curve.StartPoint(curve=offset)
endPoint = Curve.EndPoint(curve=offset)
byStartPointEndPoint = Line.ByStartPointEndPoint(startPoint=startPoint, endPoint=endPoint)
byElements = Dimension.ByElements(referenceElements=flatten_6, line=byStartPointEndPoint)  # unwired: view
ꟿ_document_activeview = Custom[ꟿ Document.ActiveView]()  # package spring nodes; Selects the current document's active view. Supports more view types than the built-in option. Will be depreciated once the bult in node works with all plan types.

# group: Ducts and Grids
ꟿ_document_activeview_2 = Custom[ꟿ Document.ActiveView]()
categories_3 = Categories("OST_DuctCurves")
all_elements_of_category_3 = ElementsOfCategory(Category=categories_3)
categories_4 = Categories("OST_Grids")
all_elements_of_category_4 = ElementsOfCategory(Category=categories_4)
geometry_3 = Element.Geometry(element=all_elements_of_category_3)
flatten_7 = List.Flatten(list=geometry_3)
code_block_4 = CodeBlock { 0; }
code_block_5 = CodeBlock { -1; }
byCoordinates = Vector.ByCoordinates(x=code_block_4, y=code_block_4, z=code_block_5)
code_block_6 = CodeBlock { "Middle Elevation"; }
getParameterValueByName = Element.GetParameterValueByName(element=all_elements_of_category_3, parameterName=code_block_6)
translate = Geometry.Translate(geometry=flatten_7, direction=byCoordinates, distance=getParameterValueByName)
curve = Grid.Curve(grid=all_elements_of_category_4)
distanceTo_2 = Geometry.DistanceTo(geometry=translate, other=curve, lacing=CrossProduct)
formula_2 = Formula("if(x=0,100000000,x)", x=distanceTo_2)
minimumItem_2 = List.MinimumItem(list=formula_2)
allIndicesOf_2 = List.AllIndicesOf(list=distanceTo_2@L2, item=minimumItem_2)
getItemAtIndex_6 = List.GetItemAtIndex(list=all_elements_of_category_4, index=allIndicesOf_2)
flatten_8 = List.Flatten(list=getItemAtIndex_6)
list_create_2 = List.Create(item0=all_elements_of_category_3, item1=flatten_8)
count_2 = List.Count(list=flatten_8)
code_block_7 = CodeBlock(x=count_2) { 0..x-1; }
getItemAtIndex_7 = List.GetItemAtIndex(list=code_block_7@L1, index=code_block_7, lacing=CrossProduct)
flatten_9 = List.Flatten(list=getItemAtIndex_7@L1)
flatten_10 = List.Flatten(list=flatten_9@L1)
getItemAtIndex_8 = List.GetItemAtIndex(list=list_create_2@L4, index=flatten_10, lacing=CrossProduct)
flatten_11 = List.Flatten(list=getItemAtIndex_8@L2)
byElements_2 = Dimension.ByElements(view=ꟿ_document_activeview_2, referenceElements=flatten_11, line=byStartPointEndPoint)
