# Dynamo graph Model in place to RFA.dyn (Dynamo 2.17.0.3472)

select_model_elements = DSModelElementsSelection()  # 1 picked in the model; graph input
geometry = Element.Geometry(element=select_model_elements)
byUnion = Solid.ByUnion(solids=geometry)
family_name = StringInput("Mech Equipment05")  # graph input
categories = Categories("OST_MechanicalEquipment")  # graph input
file_path = Filename("C:\ProgramData\Autodesk\RVT 2024\Family Templates\English-Imperial\Generic Model.rft")
string = StringInput("Default")
byName = Material.ByName(name=string)
byGeometry = FamilyType.ByGeometry(solidGeometry=byUnion, name=family_name, category=categories, templatePath=file_path, material=byName)
byGeometry_2 = BoundingBox.ByGeometry(geom=geometry)
minPoint = BoundingBox.MinPoint(boundingBox=byGeometry_2)
byPoint = FamilyInstance.ByPoint(familyType=byGeometry, point=minPoint)
